# Dynamo graph DYN-Preenchimento de Tabela em Ordem Alfabética.dyn (Dynamo 3.3.0.6316)

# group: SELECIONA OS ELEMENTOS DAS CATEGORIAS INFORMADAS
# Categorias informadas
code_block = CodeBlock()
# ---------- code_block.designscript (2 lines) ----------
category1 = Category.ByName(["Pipe Fittings", "Pipe Accessories",
"Generic Models", "Plumbing Fixtures", "Plumbing Equipment"]);
# ----------------------------------------
all_elements_of_category = ElementsOfCategory(Category=code_block)

code_block_2 = CodeBlock(IN1=all_elements_of_category) { t1 = List.Flatten(IN1, -1); t4 = Elements.Element.GetParameterValueByName(t1, "Parameter Name"); }
parameter_filter = StringInput("")  # graph input
code_block_3 = CodeBlock(IN2=code_block_2.t4, IN3=parameter_filter, IN4=code_block_2.t1) { t1 = IN2 == IN3; t5 = List.FilterByBoolMask(IN4, t1); t6 = Dictionary.ValueAtKey(t5, "in"); }

# group: Filtro de peças que não devem entrar na tabela
code_block_4 = CodeBlock(IN1=code_block_3.t6) { t4 = Elements.Element.GetParameterValueByName(IN1, "Parameter Name"); }
filtro = Python(IN[0]=code_block_3.t6, IN[1]=code_block_4)  # CPython3
# ---------- filtro.python (29 lines) ----------
# Load the Python Standard and DesignScript Libraries
import sys
import clr
clr.AddReference('ProtoGeometry')
from Autodesk.DesignScript.Geometry import *

# The inputs to this node will be stored as a list in the IN variables.
dataEnteringNode = IN

# Place your code below this line

##IN[0] Família
##IN[1] Descrição da Família
saida_descricao = []
saida_familia = []
saida_familiaF = []
conexões = ["JOELHO", "TÊ", "LUVA", "GRELHA", "CURVA"]

for i in range (len(IN[1])):
    for palavra in IN[1][i].split():
        if palavra in conexões:
            saida_familiaF.append(IN[0][i])
            break
        else:
            saida_descricao.append(IN[1][i])
            saida_familia.append(IN[0][i])
            break
# Assign your output to the OUT variable.
OUT = saida_descricao, saida_familia, saida_familiaF
# ----------------------------------------

code_block_5 = CodeBlock(a=code_block_3.t6) { a[0]; a[1]; a[2].SetParameterByName("Parameter Name", ""); }
python_script = Python(IN[0]=code_block_5.out1, IN[1]=code_block_5.out0)  # CPython3
# ---------- python_script.python (45 lines) ----------
import re
import clr

# Import RevitAPI
clr.AddReference('RevitAPI')
import Autodesk
from Autodesk.Revit.DB import *

# Import DocumentManager and TransactionManager
clr.AddReference('RevitServices')
import RevitServices
from RevitServices.Persistence import DocumentManager
from RevitServices.Transactions import TransactionManager

# Import ToDSType(bool) extension method
clr.AddReference('RevitNodes')
import Revit
clr.ImportExtensions(Revit.Elements)

# The inputs to this node will be stored as a list in the IN variables.
dataEnteringNode = IN

def natural_sort_key(s):
    return [int(text) if text.isdigit() else text.lower()
            for text in re.split(r'(\d+)', s)]

def sort_by_key(elements, parameter_values):
    sorted_pairs = sorted(zip(elements, parameter_values), key=lambda pair: natural_sort_key(pair[1]))
    return [pair[0] for pair in sorted_pairs]

# Place your code below this line
elements = IN[0]
parameter_values = IN[1]

# Ensure that elements and parameter_values are lists
if not isinstance(elements, list):
    elements = [elements]
if not isinstance(parameter_values, list):
    parameter_values = [parameter_values]

# Sort the elements by the parameter values
sorted_elements = sort_by_key(elements, parameter_values)

# Assign your output to the OUT variable.
OUT = sorted_elements
# ----------------------------------------
code_block_6 = CodeBlock(IN1=python_script) { IN1.GetParameterValueByName("Parameter Name"); }
prefixo_quando_necessário = StringInput("")  # graph input
python_script_2 = Python(IN[0]=code_block_6, IN[1]=python_script, IN[2]=prefixo_quando_necessário)  # CPython3
# ---------- python_script_2.python (30 lines) ----------
# Load the Python Standard and DesignScript Libraries
import sys
import clr
clr.AddReference('ProtoGeometry')
from Autodesk.DesignScript.Geometry import *

# The inputs to this node will be stored as a list in the IN variables.
dataEnteringNode = IN

# Place your code below this line

##IN[0] Descrição da Família
##IN[1] Elemento
##IN[2] Diametro Nominal
##IN[3] Prefixo
saida = []

for i in range (len(IN[0])):
    if i == 0:
        valor = 1
    else:
        if IN[0][i] == IN[0][i-1]:
            valor = valor
        else:
            valor = valor + 1
    saida.append(str(IN[2]) + str(valor))


# Assign your output to the OUT variable.
OUT = saida
# ----------------------------------------
code_block_7 = CodeBlock(IN1=python_script, IN2=python_script_2) { IN1.SetParameterByName("Parameter Name", IN2); }
